# Grasshopper definition simpleTruss.gh (Grasshopper 0.9.76)
# plug-ins: Python Interpreter

python = PythonScript(spacing=Slider(1.02, range=0..2), zNum=Slider(1, range=0..10), yNum=Slider(5, range=0..10))  # -> out, bars, braces, supports, load
# ---------- python: Python ----------
"""
Drawing a simple trellis.
Environment - rhinoceros + grasshopper
Language    - python

What is a simple trellis?
In structural engineering, a lattice is a structure composed 
of triangular units constructed with straight elements whose 
ends are connected at points known as knots. External forces 
and reactions are considered, in a simplified way, applied in 
these same nodes.

INPUTS
spacing  - Item acess {type him = ghdoc rhinoscriptsintax};
zNum     - Item acess {type him = ghdoc rhinoscriptsintax};
yNum     - Item acess {type him = ghdoc rhinoscriptsintax}.
OUTPUTS
out      - the execution information;
bars     - output bars {boxes};
braces   - outputs braces {diagonals};
supports - outputs supports {point of connections};
load     - outputs load {point of load}.

Reference - Danil NAGY
"""

import Rhino.Geometry as rh

points = []

for y in range(int(yNum+1)):
    points.append([])
    for z in range(int(zNum+1)):
        points[-1].append(rh.Point3d(0, y*spacing, z*spacing))

bars = []
braces = []

for i in range(len(points)):
    for j in range(len(points[i])):
        if i < len(points) - 1:
            bars.append(rh.Line(points[i][j], points[i+1][j]))
        
        if j < len(points[i]) - 1:
            bars.append(rh.Line(points[i][j], points[i][j+1]))
        
        if i < len(points) - 1 and j < len(points[i]) - 1:
            braces.append(rh.Line(points[i][j], points[i+1][j+1]))
        
        if i > 0 and j < len(points[i]) - 1:
            braces.append(rh.Line(points[i][j], points[i-1][j+1]))

supports = points[:][0]
load = points[-1][-1]
# ---------- end python ----------
pt = Point(python.supports)
pt_2 = Point(python.load)
line = Line(python.bars)
line_2 = Line(python.braces)
pipe = Pipe(Curve=line, Radius=0.02, Caps=0)
pipe_2 = Pipe(Curve=line_2, Radius=0.01, Caps=0)
preview = CustomPreview(Geometry=pipe_2, Shader=ColourSwatch(SwatchColor=RGB(98, 255, 0)))
preview_2 = CustomPreview(Geometry=pipe, Shader=ColourSwatch(SwatchColor=RGB(60, 0, 255)))
