# Grasshopper definition 003_spaceTruss.gh (Grasshopper 0.9.76)
# plug-ins: Python Interpreter

# ---- group: side of the truss
number_slider = Slider(8.3, range=0..20)

# ----
divisor = Slider(7, range=5..25)
python = PythonScript(side=number_slider, index=divisor, xNum=divisor, yNum=divisor, height=Slider(1.11, range=0.3..2.5))  # -> out, upper, below, diagonal, support, a; inputs index: Int32, xNum: Int32, yNum: Int32
# ---------- python: Python ----------
import Rhino.Geometry as rh

#size [variable] * num [variable] == side [immutable]
x = side / index
a = side
size = x

#points
points = []
#carga = []   #PROVISÓRIO

for y in range (int(yNum + 1)):
    points.append ([])
    for x in range (int(xNum +1)):
        points[-1].append (rh.Point3d(x * size,y * size, height))
#        carga.append((x * size,y * size, height)) #PROVISÓRIO adiciona pontos de cargas

points2 = []

for y in range (int(yNum)):
    points2.append ([])
    for x in range (int(xNum)):
        points2[-1].append (rh.Point3d(x * size + size/2, y * size + size/2, 0))

below = []

for i in range(len(points2)):         
    for j in range(len(points2[i])):  
        if i < len(points2) - 1:
            below.append(rh.Line(points2[i][j], points2[i+1][j]))
        if j < len(points2[i]) - 1:
            below.append(rh.Line(points2[i][j], points2[i][j+1]))

upper = []     

for i in range(len(points)):         
    for j in range(len(points[i])):  
        if i < len(points) - 1:
            upper.append(rh.Line(points[i][j], points[i+1][j]))
        if j < len(points[i]) - 1:
            upper.append(rh.Line(points[i][j], points[i][j+1]))

diagonal = []

for i in range (len(points2)):
    for j in range (len(points)):
        if i < len(points2) and j < len(points) -1 : 
            diagonal.append(rh.Line(points2[i][j], points[i][j]))

        if i >= 0 and j < len(points)-1 : 
            diagonal.append(rh.Line(points2[i][j], points[i+1][j]))

        if i < len(points2) and j < len(points)-1: 
            diagonal.append(rh.Line(points2[i][j], points[i][j+1]))

        if i >= 0 and j < len(points)-1 : 
            diagonal.append(rh.Line(points2[i][j], points[i+1][j+1]))


support = (points2[0][0], points2 [0][-1], points2[-1][0], points2[-1][-1])

a = points

print ('Side dimension: %.2f m' %(size * xNum))
numModules = index * index
print ('Number of modules: %s unid.' %numModules)
print ('Modular dimensions: %.2f m' %x)
# ---------- end python ----------
panel = Panel(python.out)
pipe = Pipe(Curve=[python.below, python.upper], Radius=0.04, Caps=0)
pipe_2 = Pipe(Curve=python.diagonal, Radius=0.02, Caps=0)
preview = CustomPreview(Geometry=pipe_2, Shader=ColourSwatch(SwatchColor=RGB(98, 255, 0)))
preview_2 = CustomPreview(Geometry=pipe, Shader=ColourSwatch(SwatchColor=RGB(60, 0, 255)))
